# Grasshopper definition Chrysalis.gh (Grasshopper 1.0.7)

# ----
# Création des extrémités des arcs
portée = Slider(34, range=20..40)
pt = ConstructPoint(XCoordinate=0, YCoordinate=0, ZCoordinate=0)
pt_2 = ConstructPoint(XCoordinate=portée, YCoordinate=0, ZCoordinate=0)

courbure_liens_1 = Slider(0.896, range=0..1.3)
courbure_liens_3 = Slider(7.02, range=2..9)
courbure_liens_2 = Slider(4.973, range=2..6)
nombre_de_liens = Slider(61, range=5..100)
epaisseur_liens = Slider(0.043, range=0.01..0.1)

flèche_arc_1 = Slider(52, range=50..60)
position_arc_1 = Slider(-0.825, range=-1..-0.6)
epaisseur_arcs = Slider(0.16, range=0.1..0.4)
flèche_arc_2 = Slider(49, range=45..60)
position_arc_3 = Slider(0.349, range=0.1..0.4)
flèche_arc_3 = Slider(46, range=45..60)
position_arc_2 = Slider(-0.235, range=-0.4..-0.1)
flèche_arc_4 = Slider(50, range=45..60)
position_arc_4 = Slider(0.814, range=0.6..1)

vec = VectorXYZ(XComponent=0, YComponent=[position_arc_1, position_arc_2, position_arc_3, position_arc_4], ZComponent=1)  # -> Vector, Length
# Tracé des arcs
cat = Catenary(PointA=pt, PointB=pt_2, Length=[flèche_arc_1, flèche_arc_2, flèche_arc_3, flèche_arc_4], Gravity=vec.Vector)

pipe = Pipe(Curve=cat, Radius=epaisseur_arcs, Caps=0)

division_arcs = DivisionArcs(L=cat, N=nombre_de_liens)  # -> D, D_3, D_2, D_5, D_8, D_4, D_6, D_7
# Tracé des liens entre les arcs
liens = Liens(
    Y=[courbure_liens_1, courbure_liens_2, courbure_liens_3],
    S_4=division_arcs.D,
    S_5=division_arcs.D_2,
    S_3=division_arcs.D_8,
    E_3=division_arcs.D_6,
    S=division_arcs.D_3,
    S_2=division_arcs.D_5,
    E=division_arcs.D_4,
    E_2=division_arcs.D_7)
pipe_2 = Pipe(Curve=liens, Radius=epaisseur_liens, Caps=0)

# ==== cluster DivisionArcs

# ----
# Division arcs
# Liste des arcs
# Nombre de liens
L = ClusterInput()
N = ClusterInput()
item = ListItem(List=L, Index=1, Wrap=True)
# Division des arcs
item_2 = ListItem(List=L, Index=0, Wrap=True)
item_3 = ListItem(List=L, Index=3, Wrap=True)
item_4 = ListItem(List=L, Index=2, Wrap=True)
divide = DivideCurve(Curve=item_2, Count=N, Kinks=False)  # -> Points, Tangents, Parameters
divide_2 = DivideCurve(Curve=item, Count=N, Kinks=False)  # -> Points, Tangents, Parameters
divide_3 = DivideCurve(Curve=item_3, Count=N, Kinks=False)  # -> Points, Tangents, Parameters
divide_4 = DivideCurve(Curve=item_4, Count=N, Kinks=False)  # -> Points, Tangents, Parameters

# ----
# Décalage des points résultant de la division
shift = ShiftList(List=divide.Points, Shift=expr("x-1", 1), Wrap=False)
shift_2 = ShiftList(List=divide_4.Points, Shift=expr("x-3", 1), Wrap=False)
shift_3 = ShiftList(List=divide_4.Points, Shift=expr("x+3", 1), Wrap=False)
shift_4 = ShiftList(List=divide_3.Points, Shift=expr("x-4", 1), Wrap=False)
shift_5 = ShiftList(List=divide_3.Points, Shift=expr("x+4", 1), Wrap=False)
shift_6 = ShiftList(List=divide.Points, Shift=expr("x+1", 1), Wrap=False)
shift_7 = ShiftList(List=divide_2.Points, Shift=expr("x-2", 1), Wrap=False)
shift_8 = ShiftList(List=divide_2.Points, Shift=expr("x+2", 1), Wrap=False)
rev = ReverseList(List=shift_4)
rev_2 = ReverseList(List=shift_2)
rev_3 = ReverseList(List=shift)
rev_4 = ReverseList(List=shift_7)
flip = FlipMatrix(Data=rev_3)
flip_2 = FlipMatrix(Data=shift_6)
flip_3 = FlipMatrix(Data=rev_4)
flip_4 = FlipMatrix(Data=shift_3)
flip_5 = FlipMatrix(Data=shift_8)
flip_6 = FlipMatrix(Data=rev)
flip_7 = FlipMatrix(Data=shift_5)
flip_8 = FlipMatrix(Data=rev_2)
D = ClusterOutput(flip)
D_2 = ClusterOutput(flip_3)
D_3 = ClusterOutput(flip_2)
D_4 = ClusterOutput(flip_4)
D_5 = ClusterOutput(flip_5)
D_6 = ClusterOutput(flip_6)
# Liste des numéros dans l'ordre
D_7 = ClusterOutput(flip_7)
D_8 = ClusterOutput(flip_8)

# ==== cluster Liens

# ----
# Création des liens
# Courbures
Y = ClusterInput()
# Paramétrage courbures
vec = VectorXYZ(XComponent=0, YComponent=Y, ZComponent=1)  # -> Vector, Length
item = ListItem(List=vec.Vector, Index=0, Wrap=True)
item_2 = ListItem(List=vec.Vector, Index=1, Wrap=True)
item_3 = ListItem(List=vec.Vector, Index=2, Wrap=True)

# ----
# Liste des points de l'arc 1 à l'envers
# Liste des points de l'arc 2 à l'envers
# Liste des points de l'arc 3 à l'envers
# Liste des points de l'arc 4 à l'envers
E = ClusterInput()
# Tracé des liens (décalage décroissant des points)
S = ClusterInput()
E_2 = ClusterInput()
S_2 = ClusterInput()
arc = ArcSED(Start=S, End=S_2, Direction=item)  # -> Arc, Plane, Radius
arc_2 = ArcSED(Start=S_2, End=E, Direction=item_2)  # -> Arc, Plane, Radius
arc_3 = ArcSED(Start=E, End=E_2, Direction=item_3)  # -> Arc, Plane, Radius

# ----
# Liste des points de l'arc 1
# Liste des points de l'arc 2
# Liste des points de l'arc 3
# Liste des points de l'arc 4
S_3 = ClusterInput()
# Tracé des liens (décalage croissant des points)
S_4 = ClusterInput()
E_3 = ClusterInput()
S_5 = ClusterInput()
arc_4 = ArcSED(Start=S_3, End=E_3, Direction=item_3)  # -> Arc, Plane, Radius
arc_5 = ArcSED(Start=S_5, End=S_3, Direction=item_2)  # -> Arc, Plane, Radius
arc_6 = ArcSED(Start=S_4, End=S_5, Direction=item)  # -> Arc, Plane, Radius

# ----
# Listes des liens
A = ClusterOutput([arc_5.Arc, arc_6.Arc, arc_4.Arc, arc.Arc, arc_2.Arc, arc_3.Arc])
